# Grasshopper definition WingedEdge_Deconstruct_Reconstruct.gh (Grasshopper 0.9.76)
# Copyright: All rights reserved
# plug-ins: Python Interpreter, SlingshotDB

# ---- group: an example dataset: scalar field / DataPreparation / VoxelData_Demo
M = Number([0.001516310981, 0.001731464927, 0.001891233151, 0.001970616271, 0.001961090484, 0.001874079448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])
pt = Point([Point(-21, -23, 0), Point(-18, -23, 0), Point(-15, -23, 0), Point(-12, -23, 0), Point(-9, -23, 0), Point(-6, -23, 0)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])

# ---- group: Table input
panel = Panel("""ID INT NOT NULL, vid INT NOT NULL , coord FLOAT[3] NOT NULL, edge INT[3] NOT NULL, PRIMARY KEY(ID, vid);
ID INT NOT NULL , eid INT NOT NULL , V0 INT NOT NULL , V1 INT NOT NULL , F0 INT NOT NULL , F1 INT NOT NULL , edges TEXT NOT NULL, PRIMARY KEY(ID, eid);
ID INT NOT NULL, fid INT NOT NULL, edges INT[] NOT NULL, PRIMARY KEY(ID,fid);
ID INT NOT NULL ,type        VARCHAR(30) NOT NULL  , geometry VARCHAR(1024) NOT NULL , PRIMARY KEY(ID)""")
panel_2 = Panel("ID, vid, coord,edge;ID,eid,v0,v1,f0,f1,edges;ID,fid,E1,E2,E3,E4;ID,type,geometry")
python = PythonScript(x="Vertex;Edge;Face;Geometry", y=panel, z=panel_2)  # -> out, a, b, c, command, toggle
# ---------- python: Python ----------
a = x.split(';')
b = y.split(';')
c = z.split(';')

toggle = True 
command = ''
for i in range(len(a)):
    command += 'DROP TABLE IF EXISTS {0};'.format(a[i])
    command += 'CREATE TABLE IF NOT EXISTS {0}({1}); \n'.format(a[i],b[i])
    

print command
# ---------- end python ----------

# ----
cstring = RS_CStringPy(server="localhost", port="5432", username="postgres", database="GEO1004_Ass1")  # -> out, CString
# ---------- cstring: Python ----------
"""
This is a component that allows you to generate a database connection string to be later used in Slingshot plugin
"""

version = 'v0.0.1'
ghenv.Component.Message = version
ghenv.Component.Name = "RS_CString.py"
ghenv.Component.NickName = 'CString'
ghenv.Component.Category = "RS"
ghenv.Component.SubCategory = "0"

#------------input------------

import Grasshopper.Kernel as gh

ghenv.Component.Params.Input[0].NickName = "driver"
ghenv.Component.Params.Input[0].Description = "(optional) Driver used for database connection, default - PostgreSQL ODBC Driver(Unicode)"
if not driver:
    driver = 'PostgreSQL ODBC Driver(Unicode)'
    
ghenv.Component.Params.Input[1].NickName = "server"
ghenv.Component.Params.Input[1].Description = "(optional) Database server, default - localhost"
if not server:
    server = 'localhost'
    
ghenv.Component.Params.Input[2].NickName = "port"
ghenv.Component.Params.Input[2].Description = "(optional) Database connection port, default - 5432"
if not port:
    port = '5432'
    
ghenv.Component.Params.Input[3].NickName = "username"
ghenv.Component.Params.Input[3].Description = "(optional) Username or User ID, default - postgres"
if not username:
    username = 'postgres'
    
ghenv.Component.Params.Input[4].NickName = "database"
ghenv.Component.Params.Input[4].Description = "(optional) Database name, default - postgres"
if not database:
    database = 'postgres'
    
ghenv.Component.Params.Input[5].NickName = "password"
ghenv.Component.Params.Input[5].Description = "Needs to be provided by the user"
if not password:
    w = gh.GH_RuntimeMessageLevel.Warning
    ghenv.Component.AddRuntimeMessage(w, 'No password provided')
    
 #------------output------------
    
ghenv.Component.Params.Output[1].NickName = "CString"
ghenv.Component.Params.Output[1].Description = "Connection String"

#------------code------------

CString = 'Driver={{{0}}}; Server={1}; Port={2}; Uid={3}; Database={4}; Pwd={5}; commandtimeout=20; Timeout=5'.format(driver, server, port, username, database, password)
# ---------- end cstring ----------

# ---- group: an example dataset: scalar field / DataPreparation
pdecon = Deconstruct(Point=pt)  # -> XComponent, YComponent, ZComponent
cluster = Cluster(t=M)  # -> C, R_2, G_2, B_2
dots = DotDisplay(Point=pt, Colour=cluster.C, Size=2)
Z = Number(pdecon.ZComponent)
M_2 = Number(M)
R = Integer(cluster.R_2)
G = Integer(cluster.G_2)
B = Integer(cluster.B_2)
X = Number(pdecon.XComponent)
Y = Number(pdecon.YComponent)
merge = Merge(Data1=graft(X), Data2=graft(Y), Data3=graft(Z), Data4=graft(M_2), Data5=graft(R), Data6=graft(G), Data7=graft(B))
join = TextJoin(Text=merge, Join=",")  # -> flatten(Result)
voxel_data = Data(join)
format = Format(Format="({0})", Culture=127, Data0=voxel_data)
join_2 = TextJoin(Text=format, Join=",")  # -> flatten(Result)
data = Data(join_2)

# ----
cstring_2 = Text(cstring.CString)

# ---- group: SQL query
querysfw = SQLSELECTString(Select="*", From="Vertex")
querysfw_2 = SQLSELECTString(Select="*", From="Face")
querysfw_3 = SQLSELECTString(Select="*", From="Edge")
toggle = BooleanToggle(True)
odbc_query = ODBCQuery(ConnectString=cstring_2, ConnectToggle=toggle, Query=querysfw, ColumnNumber=0)  # -> Exceptions, ColumnQueryResult, QueryResult
odbc_query_2 = ODBCQuery(ConnectString=cstring_2, ConnectToggle=toggle, Query=querysfw_2, ColumnNumber=0)  # -> Exceptions, ColumnQueryResult, QueryResult
odbc_query_3 = ODBCQuery(ConnectString=cstring_2, ConnectToggle=toggle, Query=querysfw_3, ColumnNumber=0)  # -> Exceptions, ColumnQueryResult, QueryResult

# ---- group: an example dataset: scalar field / example
txt = Text("INSERT INTO voxeltable() VALUES ()")

# ---- group: an example dataset: scalar field
# Read Me: You can create a voxel table and store this data to get started!
panel_3 = Panel(txt)
data_2 = Data(data)
fragment = TextFragment(Text=panel_3, Start=0, Count=22)
concat = Concatenate(FragmentA=fragment, FragmentB=" VALUES")
concat_2 = Concatenate(FragmentA=concat, FragmentB=data_2)
batchload_cmd = Text(concat_2)

# ----
reconstruct = PythonScript(vertexlist=odbc_query.QueryResult, facelist=odbc_query_2.QueryResult, edgelist=odbc_query_3.QueryResult)  # -> out, meshlist; inputs vertexlist: list, facelist: list, edgelist: list
# ---------- reconstruct: Python ----------
import Rhino.Geometry as RG
import re as re
vdict = {}
edict = {}
fdict = {}

for v in vertexlist:
    items = re.findall("[-+]?\d+[\.]?\d*[eE]?[-+]?\d*", v)
    coord = [float(items[2]),float(items[3]),float(items[4])] 
    vdict[int(items[0]),int(items[1])] = coord

for e in edgelist:
    items = re.findall("[-+]?\d+[\.]?\d*[eE]?[-+]?\d*", e)
    
    #vertices, faces
    VandF = [(int(items[2]),int(items[3])),(int(items[4]),int(items[5]))]
    
    #connected edges
    conedge = [int(i) for i in items[6:]]
    edict[int(items[0]),int(items[1])] = VandF + conedge

for f in facelist:
    items = re.findall("[-+]?\d+[\.]?\d*[eE]?[-+]?\d*", f)
    
    #take the right starting vertices (otherwise mesh can get invalid)
    e = edict[int(items[0]),int(items[2])]
    e2 = edict[int(items[0]),int(items[3])]
    if e[0][0] == e2[0][1] or e[0][0] == e2[0][0]:
        vstart = e[0][1]
    else:
        vstart = e[0][0]
    
    #make edict with vertices in order
    verttopo = []
    n = 0
    for i in items[2:]:
        e = edict[int(items[0]),int(i)]
        if vstart == e[0][0]:
            vstart = e[0][1]
        else:
            vstart = e[0][0]
        n+=1
        verttopo.append(vstart)
    fdict[int(items[0]),int(items[1])] = verttopo

meshlist = []
n,o,p = 0,0,0
while (n,o) in vdict:
    newmesh = RG.Mesh()
    
    #add all vertices of a certain buildingID
    while (n,o) in vdict:
        x,y,z = vdict[n,o]
        newmesh.Vertices.Add(x,y,z)        
        o +=1
    #add all faces of a certain buildingID
    while (n,p) in fdict:
        v1,v2,v3 = fdict[n,p][:3]
        try:
            v4 = fdict[n,p][3]
            face = RG.MeshFace(v1,v2,v3,v4)
        #if triangle and not quadrangle
        except:
            face = RG.MeshFace(v1,v2,v3)
        newmesh.Faces.AddFace(face)
        p += 1
    meshlist.append(newmesh)
    n += 1
    o,p = 0,0
# ---------- end reconstruct ----------
mesh = Mesh(reconstruct.meshlist)
odbccommand = ODBCCommand(ConnectionString=cstring_2, ConnectToggle=Toggle(False), Command=python.command)
panel_4 = Panel(odbccommand)

# ---- group: Deconstruct
brep = Brep(<brep referenced from the Rhino model>)
mesh_2 = MeshBrep(
    Brep=brep,
    Settings={GridMaxCount=0, GridMinCount=16, JaggedSeams=False, MaxEdgeLength=0, MinEdgeLength=0.0001, MinTolerance=0, Refine=True, RefineAngle=0, RelativeTolerance=0.65, SimplePlanes=True, Tolerance=0})
python_2 = PythonScript(x=mesh_2)  # -> out, a, b, c, graft(d); inputs x: Mesh
# ---------- python_2: Python ----------
import Rhino.Geometry as RG

def indict(dictionary,key,value): #used to append things in dictionary
    if key in dictionary:
        dictionary[key] += value
    else:
        dictionary[key] = value


FootprintMesh = x                                               #input: mesh
FootprintMesh.Weld                                              #delete redundant things                     
TopoEdges = RG.Mesh.TopologyEdges.GetValue(FootprintMesh)       #topological edges
TopoVertices = RG.Mesh.TopologyVertices.GetValue(FootprintMesh) #topological vertices

#Get coordinates of Topology Vertices, using real vertices
coorddict = {}
RVertices = FootprintMesh.Vertices 
for n in range(TopoVertices.Count):
    Realvertices = TopoVertices.MeshVertexIndices(n)
    coorddict[n] = RVertices[Realvertices[0]]

#Edges with vertices and faces
edgedict = {}
VertToEdge = {}
for n in range(TopoEdges.Count):
    #Left face is 0, right face is 1
    left = TopoEdges.GetConnectedFaces(n)[0]
    right = TopoEdges.GetConnectedFaces(n)[1]
    
    #v0 is beginning vertex of edge, v1 is the end vertex
    v0 = TopoEdges.GetTopologyVertices(n).I
    v1 = TopoEdges.GetTopologyVertices(n).J
    
    #edgedict with both vertices and faces
    edgedict[n] = [(v0,v1),(left,right)]
    
    #reverse dictionary, used to see if orientation is positive or negative
    VertToEdge[(v0,v1)] = n

#Faces:
facedict = {}
TopoFace = FootprintMesh.Faces
for i in range(TopoFace.Count):
    #FaceVert is list of toplogical (CCW) vertices of a face
    #if edge is related CCW, it is positive
    #elif edge is related CW, it is negative
    FaceVert = TopoFace.GetTopologicalVertices(i)
    for n in range(len(FaceVert)):
        v0 = FaceVert[n-1]
        v1 = FaceVert[n] 
        if (v0,v1) in VertToEdge:
            #indict(facedict,i,[[VertToEdge[(v0,v1)],]])
            indict(facedict,i,[[VertToEdge[(v0,v1)],'pos']])
        elif v0 == v1:
            pass
        else:
            #indict(facedict,i,[[VertToEdge[(v1,v0)]]])
            indict(facedict,i,[[VertToEdge[(v1,v0)],'neg']])

#Vertices with coordinates and edges:
vertexdict = {}
for e in range(len(edgedict)):
    vtuple = edgedict[e][0] #get vertices of edge
    for v in vtuple:
        
        #if existing vertex
        if v in vertexdict:
            vertexdict[v][1] += [e]
        
        #if vertex is not yet existing
        else:
            x = coorddict[v].X
            y = coorddict[v].Y
            z = coorddict[v].Z
            vertexdict[v] = [[x,y,z],[e]]

#Edges that are related to each other
relatededges = {}
for e,etuple in edgedict.items():
    vtuple = etuple[0] #tuple of vertices
    for v in vtuple:
        edges = vertexdict[v][1]
        i = edges.index(e)
        
        #take edges before and after the edge that is used:
        #winged only takes 2 edges into account
        if edges[i] != edges[-1]:
            elist = edges[(i+1)], edges[(i-1)]
        else:
            elist = edges[0], edges[(i-1)]
        indict(relatededges,e,elist)

#append related edges to edgedictionary
for e in edgedict.keys():
    etuple = tuple(relatededges[e])
    edgedict[e] = edgedict[e] + [etuple]

#write WKT
coordstring = 'POLYHEDRALSURFACE Z ('
for face,edgevalues in facedict.items():
    vlist = []
    
    for edgevalue in edgevalues:
        #'pos' or 'neg' orientation
        orientation = edgevalue[1]
        #begin and endpoints of edge
        verticestuple = edgevalue[0]
        
        if orientation == 'pos':
            #take first value of verticestuple
            vlist += [edgedict[verticestuple][0][0]]
            
        else:
            #take second value of verticestuple
            vlist += [edgedict[verticestuple][0][1]]
    
    #append first value again (for WKT
    vlist += [vlist[0]]
    #convert to coordinates
    WKTcoord = [vertexdict[v][0] for v in vlist]
    
    #write WKT
    coordstring += '(('
    for coord in WKTcoord:
        coordstring += '{0} {1} {2},'.format(coord[0],coord[1],coord[2])
    coordstring = coordstring[:-1]
    coordstring += ')),'
WKT = coordstring[:-2] + ' )'

#assign output
a = vertexdict.items()
b = edgedict.items()
c = facedict.items()
d = WKT
# ---------- end python_2 ----------

# ---- group: Deconstruct / Get building ID's
viewer = ParamViewer(python_2.a)
graft = GraftTree(Tree=viewer, IncludeEmptyLists=True, IncludeNullItems=True)

# ---- group: Deconstruct (continued)
python_3 = PythonScript(GeometryWKT=python_2.d, buildingID=graft)  # -> out, a
# ---------- python_3: Python ----------
#metadata
ID = buildingID.Indices[1]
table = 'Geometry'
columns = 'ID,type,geometry'

#write
output = 'INSERT INTO {0}({1}) VALUES {2};'.format(table,columns,(ID,'MULTIPOLYGON',GeometryWKT))
a = output
# ---------- end python_3 ----------
python_4 = PythonScript(Vertices=python_2.a, buildingID=graft)  # -> out, a
# ---------- python_4: Python ----------
#metadata
ID = buildingID.Indices[1]
table = 'Vertex'
columns = 'ID,vid,coord,edge'

#input
featid,attr = Vertices
strcoord =  str(attr[0]).strip('[]')
stredges = str(attr[1]).strip('[]')
coord = '{'+strcoord+'}' #array of coordinates SQL
edges = '{'+stredges+'}' #array of edges SQL

#write
output = 'INSERT INTO {0}({1}) VALUES {2};'.format(table,columns,(ID,featid,coord,edges))
a = output
# ---------- end python_4 ----------
python_5 = PythonScript(Edges=python_2.b, buildingID=graft)  # -> out, a
# ---------- python_5: Python ----------
#metadata
ID = buildingID.Indices[1]
table = 'Edge'
columns = 'ID,eid,v0,v1,f0,f1,edges'

#values
featid,attr = Edges
v0,v1,f0,f1 = [i for i in attr[0]] + [i for i in attr[1]]
edges = attr[2]

#write
output = 'INSERT INTO {0}({1}) VALUES {2};'.format(table,columns,(ID,featid,v0,v1,f0,f1,edges))
a = output
# ---------- end python_5 ----------
python_6 = PythonScript(Faces=python_2.c, buildingID=graft)  # -> out, a
# ---------- python_6: Python ----------
#metadata
ID = buildingID.Indices[1]
columns = 'ID,fid,edges'
table = 'Face'

#input
featid,attr = Faces
edges = [i[0] for i in attr]
edges = '{'+str(edges).strip('[]')+'}'

#write
output = 'INSERT INTO {0}({1}) VALUES {2};'.format(table,columns,(ID,featid,edges))
a = output
# ---------- end python_6 ----------

# ----
odbccommand_2 = ODBCCommand(ConnectionString=cstring_2, ConnectToggle=Toggle(False), Command=[python_4.a, python_3.a, python_6.a, python_5.a])
panel_5 = Panel(odbccommand_2)

# ==== cluster Cluster
t = ClusterInput()
t_2 = Parameter(t)
bnd = Bounds(Numbers=t_2)
dedomain = DeconstructDomain(Domain=bnd)  # -> Start, End
gradient = Gradient(
    LowerLimit=dedomain.Start,
    UpperLimit=dedomain.End,
    Parameter=t_2,
    stops=[0: RGB(234, 38, 0), 0.0342: RGB(234, 126, 0), 0.0699: RGB(254, 244, 84), 0.0942: RGB(173, 203, 249), 1: RGB(75, 107, 169)])
col = Colour(gradient)
C = ClusterOutput(gradient)
vb = VBScript(x=col)  # -> out, R, G, B; inputs x: Color
# ---------- vb: C# ----------
    R = x.R
    G = x.G
    B = x.B
# ---------- end vb ----------
R = Number(vb.R)
G = Number(vb.G)
B = Number(vb.B)
R_2 = ClusterOutput(R)
G_2 = ClusterOutput(G)
B_2 = ClusterOutput(B)
